# Dynamo graph comment_control.dyn "controllo commenti" (Dynamo 2.19.3.6394)

categories = Categories("OST_Walls")
all_elements_of_category = ElementsOfCategory(Category=categories)
string = StringInput("Commenti")
getParameterValueByName = Element.GetParameterValueByName(element=all_elements_of_category, parameterName=string)
watch = Watch(getParameterValueByName)
watch_2 = Watch()  # unwired: arg0
python_script = Python(IN[0]=getParameterValueByName)  # CPython3
# ---------- python_script.python (31 lines) ----------
# Importa le librerie necessarie (anche se non tutte sono usate in questo piccolo script, è una buona pratica)
import clr
clr.AddReference('RevitAPI')
clr.AddReference('ProtoGeometry')
from Autodesk.DesignScript.Geometry import *

# L'input IN[0] di questo specifico nodo Python sarà la lista di stringhe (i commenti di tutti i muri)
input_comments = IN[0]

# Lista per contenere i valori booleani della maschera filtrante
# Vogliamo TRUE per i commenti che NON sono vuoti (cioè contengono testo significativo)
# e FALSE per quelli VUOTI (null, "", o solo spazi)
boolean_mask = []

# Itera attraverso ogni commento nella lista di input
for comment in input_comments:
    # Controlla se il commento NON è None (nullo in Python)
    # E se il commento, dopo averlo convertito in stringa (per sicurezza)
    # e aver rimosso gli spazi bianchi all'inizio e alla fine (.strip()),
    # NON è una stringa vuota.
    if comment is not None and str(comment).strip() != "":
        # Se il commento non è nullo E non è vuoto dopo aver rimosso gli spazi,
        # allora è un commento valido --> mettiamo True nella maschera
        boolean_mask.append(True)
    else:
        # Altrimenti, il commento è nullo OPPURE è una stringa vuota/solo spazi
        # --> mettiamo False nella maschera
        boolean_mask.append(False)

# L'output di questo nodo Python sarà la lista di True/False che servirà come maschera per il List.FilterByBoolMask
OUT = boolean_mask
# ----------------------------------------
filterByBoolMask = List.FilterByBoolMask(list=all_elements_of_category, mask=python_script)
watch_3 = Watch(filterByBoolMask.in)
id = Element.Id(element=filterByBoolMask.in)
name = Element.Name(element=filterByBoolMask.in)
getParameterValueByName_2 = Element.GetParameterValueByName(element=filterByBoolMask.in, parameterName=string)
python_script_2 = Python(IN[0]=id, IN[1]=name, IN[2]=getParameterValueByName_2)  # CPython3
# ---------- python_script_2.python (38 lines) ----------
# Importa la libreria del Common Language Runtime (CLR) di Python per interagire con le API di Dynamo/Revit
import clr

clr.AddReference('RevitAPI')
clr.AddReference('RevitAPIUI')
clr.AddReference('ProtoGeometry')  # Per Geometry (Point, Vector, ecc.)

# Importa i tipi di Dynamo
from Autodesk.DesignScript.Geometry import *

# Importa i tipi di Revit
from Autodesk.Revit.DB import *

# L'input "IN[0]" sarà la lista degli ID
# L'input "IN[1]" sarà la lista dei Nomi dei Muri
# L'input "IN[2]" sarà la lista dei Commenti

ids = IN[0]
names = IN[1]
comments = IN[2]

# Lista per contenere i dati combinati (ID, Nome Muro, Commento per ogni riga)
combined_data = []

# Assicurati che le liste abbiano la stessa lunghezza
# (dovrebbero avere la stessa lunghezza se provengono dagli stessi elementi filtrati)
min_length = min(len(ids), len(names), len(comments))

# Aggiungi l'intestazione alla lista dei dati
combined_data.append(["ID", "Nome Muro", "Commento"])

# Itera attraverso le liste e combina gli elementi
for i in range(min_length):
    # Ogni elemento della lista 'combined_data' sarà una sub-lista [ID, Nome Muro, Commento]
    combined_data.append([ids[i], names[i], comments[i]])

# L'output del Python Script node sarà la lista 'combined_data'
OUT = combined_data
# ----------------------------------------
watch_4 = Watch(python_script_2)
watch_5 = Watch(categories)
watch_6 = Watch(name)
watch_7 = Watch(id)
file_path = Filename(".\commenti.xlsx")
string_2 = StringInput("Nomi Errati")
number = DoubleInput(0)
number_2 = DoubleInput(0)
boolean = BoolSelector(true)
exportToExcel = Data.ExportToExcel(filePath=file_path, sheetName=string_2, startRow=number, startColumn=number_2, data=python_script_2, overWrite=boolean)  # graph output
watch_8 = Watch(exportToExcel)
watch_9 = Watch()  # unwired: arg0
watch_10 = Watch(getParameterValueByName_2)
watch_11 = Watch(all_elements_of_category)
watch_12 = Watch(getParameterValueByName)
watch_13 = Watch(python_script)
