# Dynamo graph materials_control.dyn "controllo_materiali_non_mat" (Dynamo 2.19.3.6394)

categories = Categories("OST_Walls")
all_elements_of_category = ElementsOfCategory(Category=categories)
id = Element.Id(element=all_elements_of_category)
boolean = BoolSelector(false)
getMaterials = Element.GetMaterials(element=all_elements_of_category, paintMaterials=boolean)
name = Material.Name(material=getMaterials, lacing=Longest)
string = StringInput("MAT_")
boolean_2 = BoolSelector(true)
startsWith = String.StartsWith(string=name, searchFor=string, ignoreCase=boolean_2, lacing=Longest)
watch = Watch(startsWith)
watch_2 = Watch(name)
allTrue = List.AllTrue(list=startsWith, lacing=Longest)
filterByBoolMask = List.FilterByBoolMask(list=all_elements_of_category, mask=allTrue)
watch_3 = Watch(filterByBoolMask.out)
id_2 = Element.Id(element=filterByBoolMask.out)
name_2 = Element.Name(element=filterByBoolMask.out)
boolean_3 = BoolSelector(false)
getMaterials_2 = Element.GetMaterials(element=filterByBoolMask.out, paintMaterials=boolean_3)
name_3 = Material.Name(material=getMaterials_2, lacing=Longest)
code_block = CodeBlock(x=name_3) { x.Count == 0 ? "Nessun Materiale" : String.Join(", ", x); }  # unwired: String
map = List.Map(list=name_3, function=code_block)
python_script = Python(IN[0]=id_2, IN[1]=name_2, IN[2]=map)  # IronPython2
# ---------- python_script.python (57 lines) ----------
# Importa la libreria del Common Language Runtime (CLR) di Python per interagire con le API di Dynamo/Revit
import clr

# Aggiunge i riferimenti alle librerie necessarie di Revit API e ProtoGeometry
clr.AddReference('RevitAPI')
clr.AddReference('RevitAPIUI')
clr.AddReference('ProtoGeometry') # Per Geometry (Point, Vector, ecc.)

# Importa i tipi di Dynamo (non strettamente necessari per questo script ma buone pratiche)
from Autodesk.DesignScript.Geometry import *

# Importa i tipi di Revit (non strettamente necessari per questo script ma buone pratiche)
from Autodesk.Revit.DB import *

# ====================================================================
# Input del nodo Python Script
# --------------------------------------------------------------------
# IN[0] sarà la lista degli ID degli elementi (proveniente da Element.Id)
# IN[1] sarà la lista dei Nomi degli elementi (proveniente da Element.Name)
# IN[2] NON verrà più usato per la tabella finale, ma potresti ancora usarlo
#       per i tuoi filtri a monte, quindi lascialo pure connesso nel grafico
# ====================================================================

ids = IN[0]
names = IN[1]
# material_names = IN[2]  <-- Non useremo più questo input per la tabella finale

# Lista per contenere i dati combinati, dove ogni sottolista sarà una riga del file Excel
# Vogliamo aggiungere le intestazioni di colonna all'inizio
combined_data = []

# Aggiungi la riga delle intestazioni di colonna
# Le intestazioni devono essere nell'ordine in cui vuoi le colonne
headers = ["ID", "Nome Muro"]
combined_data.append(headers)

# ====================================================================
# Controllo di coerenza delle lunghezze delle liste
# --------------------------------------------------------------------
# Verrà utilizzata la lunghezza della lista più corta tra ID e Nomi.
# Dovrebbero essere della stessa lunghezza se provengono dagli stessi elementi filtrati.
# ====================================================================
min_length = min(len(ids), len(names))

# Itera attraverso le liste e combina gli elementi in sottoliste
for i in range(min_length):
    # Aggiunge una sottolista [ID, Nome Elemento] per ogni elemento
    # Abbiamo rimosso 'material_names[i]' qui
    combined_data.append([ids[i], names[i]])

# ====================================================================
# Output del nodo Python Script
# --------------------------------------------------------------------
# La lista 'combined_data' sarà l'output del nodo,
# pronta per essere esportata direttamente in Excel.
# ====================================================================
OUT = combined_data
# ----------------------------------------
watch_4 = Watch(python_script)
watch_5 = Watch(categories)
watch_6 = Watch(name_2)
watch_7 = Watch(id_2)
file_path = Filename(".\materiali.xlsx")
string_2 = StringInput("Nomi Errati")
number = DoubleInput(0)
number_2 = DoubleInput(0)
boolean_4 = BoolSelector(true)
exportToExcel = Data.ExportToExcel(filePath=file_path, sheetName=string_2, startRow=number, startColumn=number_2, data=python_script, overWrite=boolean_4)  # graph output
watch_8 = Watch(exportToExcel)
watch_9 = Watch(getMaterials)
watch_10 = Watch(getMaterials_2)
watch_11 = Watch(allTrue)
