# Dynamo graph name_control.dyn "controllo nomi" (Dynamo 2.19.3.6394)

categories = Categories("OST_Walls")
all_elements_of_category = ElementsOfCategory(Category=categories)
id = Element.Id(element=all_elements_of_category)
name = Element.Name(element=all_elements_of_category)
watch = Watch(name)
string = StringInput("MU_")
boolean = BoolSelector(true)
startsWith = String.StartsWith(string=name, searchFor=string, ignoreCase=boolean)
watch_2 = Watch(startsWith)
filterByBoolMask = List.FilterByBoolMask(list=all_elements_of_category, mask=startsWith)
watch_3 = Watch(filterByBoolMask.out)
id_2 = Element.Id(element=filterByBoolMask.out)
name_2 = Element.Name(element=filterByBoolMask.out)
python_script = Python(IN[0]=id_2, IN[1]=name_2)  # CPython3
# ---------- python_script.python (32 lines) ----------
# Importa la libreria del Common Language Runtime (CLR) di Python per interagire con le API di Dynamo/Revit
import clr
clr.AddReference('RevitAPI')
clr.AddReference('RevitAPIUI')
clr.AddReference('ProtoGeometry') # Per Geometry (Point, Vector, ecc.)

# Importa i tipi di Dynamo
from Autodesk.DesignScript.Geometry import *

# Importa i tipi di Revit
from Autodesk.Revit.DB import *

# L'input "IN[0]" sarà la lista degli ID
# L'input "IN[1]" sarà la lista dei Nomi
ids = IN[0]
names = IN[1]

# Lista per contenere i dati combinati (ID e Nome per ogni riga)
combined_data = []

# Assicurati che le liste abbiano la stessa lunghezza per evitare errori
# Usiamo la lunghezza della lista più corta per non avere errori se una è più lunga dell'altra
# (anche se idealmente dovrebbero avere la stessa lunghezza provenendo dagli stessi elementi)
min_length = min(len(ids), len(names))

# Itera attraverso le liste e combina gli elementi
for i in range(min_length):
    # Ogni elemento della lista 'combined_data' sarà una sub-lista [ID, Nome]
    combined_data.append([ids[i], names[i]])

# L'output del Python Script node sarà la lista 'combined_data'
OUT = combined_data
# ----------------------------------------
watch_4 = Watch(python_script)
watch_5 = Watch(categories)
watch_6 = Watch(name_2)
watch_7 = Watch(id_2)
file_path = Filename("C:\Users\filippide.beltrame\OneDrive - Gruppo Carron\Desktop\controllo nomi\nomimancanti.xlsx")
string_2 = StringInput("Nomi Errati")
number = DoubleInput(0)
number_2 = DoubleInput(0)
exportToExcel = Data.ExportToExcel(filePath=file_path, sheetName=string_2, startRow=number, startColumn=number_2, data=python_script)  # graph output
watch_8 = Watch(exportToExcel)
